vi "Analog Input.gvi"   [LabVIEW NXG 4.0.0]
panel controls:
  "stop": bool
  "Duration": f64 = 1  # Change the duration to affect the duration of data returned by each call to DAQmx Read. Note, increasing the duration will show more data in the graph and will also lead to longer intervals between data updates.
panel indicators:
  "Graph": waveform<f64>[]
uses:
  NI::DAQmx::Internal::DAQmx Start Task.gvi
  NI::DAQmx::Internal::DAQmx Read (Analog 1D Wfm NChan NSamp Duration).gvi
  NI::DAQmx::Internal::DAQmx Stop Task.gvi
  NI::G Core::Error::Display Error.gvi
diagram:
  # Start
  # DAQmx task.
  call "DAQmx Start Task.gvi"(task in="Analog Input") -> (task out=w1, error out=w2)
  while {
    # Read from
    # DAQmx task.
    call "DAQmx Read (Analog 1D Wfm NChan NSamp Duration).gvi"(task in=w1, error in=w2, duration=$Duration) -> (task out=w3, error out=w4, data=w5)
    # Display waveform
    # data on a graph.
    $Graph <- w5
    # Stop this loop if user clicks
    # stop button or when an error occurs.
    Logical Or(w4, $stop) -> w6
    stop if w6
  }
  # Stop
  # DAQmx task.
  call "DAQmx Stop Task.gvi"(task in=w3, error in=w4) -> (error out=w7)
  # Display an error
  # if one occurred.
  call "Display Error.gvi"(error in=w7)
