vi "Analog Output.gvi"   [LabVIEW NXG 4.0.0]
# These programs demonstrate automation of DAQmx input and output tasks.
panel controls:
  "Stop": bool
  "Frequency": f64 = 17
  "Amplitude": f64 = 2
  "Offset": f64
panel indicators:
  "Graph": waveform<f64>
  "Sample Rate": f64
  "AO.Max": f64
  "AO.Min": f64
uses:
  NI::Analysis::Generation::Sine Waveform.gvi
  NI::DAQmx::Internal::DAQmx Write (Analog Wfm 1Chan NSamp).gvi
  NI::DAQmx::Internal::DAQmx Stop Task.gvi
  NI::G Core::Error::Display Error.gvi
diagram:
  # Reference a configured
  # DAQmx analog output task.
  w1 = "Analog Output"  # DAQmx Task
  # Use the Function Generator to begin automating your test signal generation.
  Property Node(instance in=w1) -> ("AO_Max_1186"=w2, "AO_Min_1187"=w3, instance out=w4)
  # Sample Rate configured in the task limits maximum frequency of generated sinewave.
  Property Node(instance in=w4) -> ("SampClk_Rate_1344"=w5, error out=w6, instance out=w7)
  Multiply(w5, 0.5) -> w8
  w9 = 1  # waveform duration
  Multiply(w5, w9) -> w10
  Round To Nearest(number=w10) -> w11
  Divide(x=w5, y=w11) -> w12
  To Signed 32 Bit Integer(number=w11) -> w13
  while {
    # Calculate discrete samples of sine waveform.
    # This program maintains phase continuity of the calculated signal.
    # Coerce frequency.
    Max And Min(x=$Frequency, y=w8) -> (min(x,y)=w14: f64)
    Divide(x=w14, y=w12) -> w15
    Round To Nearest(number=w15) -> w16
    Multiply(w12, w16) -> w17
    call "Sine Waveform.gvi"(amplitude=$Amplitude, frequency=w17, error in=w6, sample rate=w5, samples=w13, offset=$Offset) -> (sine wave=w18, error out=w19)
    # Coerced waveform is clipped such that signal is within configured output range.
    Waveform In Range And Coerce[IncludeHighLimit=True](lower limit=w3, upper limit=w2, x=w18) -> w20
    # Write waveform to the DAQmx device
    # (automatically start on first write).
    call "DAQmx Write (Analog Wfm 1Chan NSamp).gvi"(task in=w7, error in=w19, data=w20, auto start=TRUE) -> (task out=w21, error out=w22)
    # Stops this loop when you select the Stop button on the panel or when an error occurs.
    Logical Or(w22, $Stop) -> w23
    $Graph <- w20
    stop if w23
  }
  # Stop
  # DAQmx task.
  call "DAQmx Stop Task.gvi"(task in=w21, error in=w22) -> (error out=w24)
  call "Display Error.gvi"(error in=w24)
  $"Sample Rate" <- w5
  $"AO.Max" <- w2
  $"AO.Min" <- w3
