vi "Counter Input - Events.gvi"   [LabVIEW NXG 4.0.0]
panel controls:
  "Stop": bool
panel indicators:
  "Event counted": u32
  "Events": i32
uses:
  NI::DAQmx::Internal::DAQmx Start Task.gvi
  NI::DAQmx::Internal::DAQmx Read (Counter U32 1Chan 1Samp).gvi
  NI::DAQmx::Internal::DAQmx Stop Task.gvi
  NI::G Core::Error::Display Error.gvi
diagram:
  w1 = "Counter Input - Events"  # Event Counter Task
  # Start the task.
  call "DAQmx Start Task.gvi"(task in=w1) -> (task out=w2, error out=w3)
  while {
    call "DAQmx Read (Counter U32 1Chan 1Samp).gvi"(task in=w2, error in=w3) -> (task out=w4, error out=w5, data=w6)
    $"Event counted" <- w6
    To Signed 32 Bit Integer(number=w6) -> w7
    # Read the events counting up or down.
    $Events <- w7
    # Stop the program if the user clicks the stop button or if there is an error.
    Logical Or(w5, $Stop) -> w8
    Wait(time to wait=100)
    stop if w8
  }
  # Stop the task.
  call "DAQmx Stop Task.gvi"(task in=w4, error in=w5) -> (error out=w9)
  # Display any errors.
  call "Display Error.gvi"(error in=w9)
