vi "Counter Input - Frequency.gvi"   [LabVIEW NXG 4.0.0]
panel controls:
  "Stop": bool
panel indicators:
  "Measured Frequency (Hz)": f64
  "Frequency Measurement": f64
uses:
  NI::DAQmx::Internal::DAQmx Start Task.gvi
  NI::DAQmx::Internal::DAQmx Read (Counter DBL 1Chan 1Samp).gvi
  NI::DAQmx::Internal::DAQmx Stop Task.gvi
  NI::G Core::Error::Display Error.gvi
diagram:
  w1 = "Counter Input - Frequency"  # Frequency Counter Task
  # Start the task.
  call "DAQmx Start Task.gvi"(task in=w1) -> (task out=w2, error out=w3)
  while {
    call "DAQmx Read (Counter DBL 1Chan 1Samp).gvi"(task in=w2, error in=w3) -> (task out=w4, error out=w5, data=w6)
    $"Measured Frequency (Hz)" <- w6
    $"Frequency Measurement" <- w6
    # Stop the program if the user clicks the stop button or if there is an error.
    Logical Or(w5, $Stop) -> w7
    Wait(time to wait=100)
    stop if w7
  }
  # Stop the task.
  call "DAQmx Stop Task.gvi"(task in=w4, error in=w5) -> (error out=w8)
  # Display any errors.
  call "Display Error.gvi"(error in=w8)
