vi "Counter Output.gvi"   [LabVIEW NXG 4.0.0]
panel controls:
  "Stop": bool
  "Frequency (Hz)": f64 = 100
  "Duty Cycle": f64 = 0.5
panel indicators:
  "Expected Pulse Generation": waveform<f64>
uses:
  NI::DAQmx::Internal::DAQmx Start Task.gvi
  NI::DAQmx::Internal::DAQmx Write (Counter Frequency 1Chan 1Samp).gvi
  NI::Analysis::Generation::Square Waveform.gvi
  NI::DAQmx::Internal::DAQmx Stop Task.gvi
  NI::G Core::Error::Display Error.gvi
diagram:
  w1 = "Counter Output"  # DAQmx Task
  # Start Pulse Generation with the counter.
  call "DAQmx Start Task.gvi"(task in=w1) -> (task out=w2, error out=w3)
  while {
    # Change the Frequency and Duty Cycle of the Pulse.
    call "DAQmx Write (Counter Frequency 1Chan 1Samp).gvi"(task in=w2, error in=w3, frequency=$"Frequency (Hz)", duty cycle=$"Duty Cycle") -> (task out=w4, error out=w5)
    # Stop the program if the user clicks the stop button or if there is an error.
    Logical Or(w5, $Stop) -> w6
    w7 = 100  # duty cycle in %
    Multiply($"Duty Cycle", w7) -> w8
    w9 = 100  # signal frequency
    Multiply($"Frequency (Hz)", w9) -> w10
    # Simulate the generated pulse.
    w11 = 5  # number of cycles
    Divide(x=w11, y=$"Frequency (Hz)") -> w12
    Multiply(w10, w12) -> w13
    Increment(x=w13) -> w14
    call "Square Waveform.gvi"(frequency=$"Frequency (Hz)", reset phase=TRUE, sample rate=w10, samples=w14, duty cycle=w8) -> (square wave=w15)
    $"Expected Pulse Generation" <- w15
    w16 = 1000  # 1000 ms/s
    Divide(x=w16, y=$"Frequency (Hz)") -> w17
    To Unsigned 32 Bit Integer(number=w17) -> w18
    Max And Min(x=100, y=w18) -> (max(x,y)=w19: u32)
    # Delay the loop to allow avoid constantly calling the generation.
    Wait(time to wait=w19)
    stop if w6
  }
  # Stop the task.
  call "DAQmx Stop Task.gvi"(task in=w4, error in=w5) -> (error out=w20)
  # Display any errors.
  call "Display Error.gvi"(error in=w20)
