vi "Digital Input.gvi"   [LabVIEW NXG 4.0.0]
panel controls:
  "Stop": bool
panel indicators:
  "Boolean Data (LSB .. MSB)": bool[]
  "Hexadecimal Data": u32
  "Binary Data": u32
  "Boolean Data (MSB .. LSB)": bool[]
  "Decimal Data": u32
uses:
  NI::DAQmx::Internal::DAQmx Start Task.gvi
  NI::DAQmx::Internal::DAQmx Read (Digital 1D Bool NChan 1Samp 1Line).gvi
  NI::DAQmx::Internal::DAQmx Stop Task.gvi
  NI::G Core::Error::Display Error.gvi
diagram:
  # This task is configured to read eight digital lines.
  w1 = "Digital Input"  # DAQmx Task
  # Start
  # DAQmx task.
  call "DAQmx Start Task.gvi"(task in=w1) -> (task out=w2, error out=w3)
  # Use the Digital Reader to begin automating your measurement.
  while {
    w4 = 250  # Loop Time
    # You can control the loop time to throttle the rate
    # the data is read from the DAQ device.
    Wait(time to wait=w4)
    # Note, the default timeout for DAQmx Read is 10 s.
    # If Loop Time or Start Trigger results in a longer time,
    # DAQmx Read will return a timeout error.
    # Read from
    # DAQmx task.
    call "DAQmx Read (Digital 1D Bool NChan 1Samp 1Line).gvi"(task in=w2, error in=w3) -> (task out=w5, error out=w6, data=w7)
    $"Boolean Data (LSB .. MSB)" <- w7
    Reverse 1D Array(array=w7) -> (reversed array=w8)
    $"Boolean Data (MSB .. LSB)" <- w8
    Boolean Array To Number(Boolean array=w7) -> (number=w9)
    $"Binary Data" <- w9
    # Stops the program when you select the Stop button on the panel or when an error occurs.
    Logical Or(w6, $Stop) -> w10
    $"Hexadecimal Data" <- w9
    # Read the simulated values and display them
    # in a Boolean array and a hexadecimal value.
    $"Decimal Data" <- w9
    stop if w10
  }
  # Stop DAQmx task.
  call "DAQmx Stop Task.gvi"(task in=w5, error in=w6) -> (error out=w11)
  # Display errors.
  call "Display Error.gvi"(error in=w11)
