vi "Digital Output.gvi"   [LabVIEW NXG 4.0.0]
panel controls:
  "Stop": bool
  "Boolean Data": bool[] = [FALSE, TRUE, FALSE, TRUE, FALSE, FALSE, TRUE, TRUE]
uses:
  NI::DAQmx::Internal::DAQmx Start Task.gvi
  NI::DAQmx::Internal::DAQmx Write (Digital 1D Bool NChan 1Samp 1Line).gvi
  NI::DAQmx::Internal::DAQmx Stop Task.gvi
  NI::G Core::Error::Display Error.gvi
diagram:
  w1 = "Digital Output"  # DAQmx Task
  # Start
  # DAQmx Task.
  call "DAQmx Start Task.gvi"(task in=w1) -> (task out=w2, error out=w3)
  # Use the Digital Writer to begin automating your measurement.
  s1 = w2  # shift register
  while {
    w4 = 250  # Loop Time
    # You can use the loop time to throttle
    # the rate the data is written to the DAQ device.
    Wait(time to wait=w4)
    # Write the Boolean Data to the DAQ device.
    # Note, the default timeout for DAQmx Write is 10 s.
    # Write to
    # digital lines.
    call "DAQmx Write (Digital 1D Bool NChan 1Samp 1Line).gvi"(task in=s1, error in=w3, data=$"Boolean Data") -> (task out=w5, error out=w6)
    # Stops the program when you select the Stop button on the panel or when an error occurs.
    Logical Or(w6, $Stop) -> w7
    next s1 = w5
    stop if w7
  }
  # Stop
  # DAQmx Task.
  call "DAQmx Stop Task.gvi"(task in=s1, error in=w6) -> (error out=w8)
  # Display errors.
  call "Display Error.gvi"(error in=w8)
